# Grasshopper definition example7.gh (Grasshopper 1.0.7)
# plug-ins: LunchBox

tparameter = Slider(0.3, range=0..1)
udivision = Slider(22, range=0..100)
vdivision = Slider(18, range=0..100)
surface_01 = Surface(reparameterize(<surface referenced from the Rhino model>))

# ---- group: input_context_components
u_division = GetInteger(udivision, AtLeast=1, AtMost=1, Maximum=2147483647, Minimum=-2147483648, TreeAccess=False)
v_division = GetInteger(vdivision, AtLeast=1, AtMost=1, Maximum=2147483647, Minimum=-2147483648, TreeAccess=False)
t_parameter = GetNumber(tparameter, AtLeast=1, AtMost=1, Maximum=1.797693135e+308, Minimum=-1.797693135e+308, TreeAccess=False)

# ----
hexagon_cells = HexagonCells(Surface=surface_01, UDivisions=u_division, VDivisions=v_division, TParameter=t_parameter)  # -> HexagonCells, Centers
number_slider = Slider(0, range=0..100)  # disabled
number_slider_2 = Slider(1, range=0..100)  # disabled
number_slider_3 = Slider(246, range=0..1000)  # disabled
explode = Explode(Curve=hexagon_cells.HexagonCells, Recursive=True)  # -> Segments, Vertices
gradient = Gradient(
    LowerLimit=number_slider,
    UpperLimit=number_slider_2,
    Parameter=number_slider_3,
    stops=[0: RGB(112, 182, 124), 0.317: RGB(255, 130, 160), 0.694: RGB(198, 227, 3), 0.928: RGB(220, 0, 40)])  # disabled
list_length = ListLength(List=explode.Segments)
equality = Equality(FirstNumber=list_length, SecondNumber=Slider(6, range=0..10))  # -> Equality, Inequality
panel = Panel(gradient)  # disabled
cull_pattern = CullPattern(List=hexagon_cells.HexagonCells, CullPattern=flatten(equality.Equality))
c_script = CSharpScript(color=gradient)  # -> out, A; disabled
# ---------- c_script: C# ----------
    var c = color.R + "," + color.G + "," + color.B;
    crv.SetUserString("color", c);
    A = crv;
# ---------- end c_script ----------
curve = Curve(cull_pattern)
curve_2 = Curve(c_script.A)  # disabled
context_bake = ContextBake(Geometry=curve)
